% Simulink data dictionary Data_diction.sldd

pwrSwitch = 1
f_tbrake_t_bpt = [0 15 26.42857 37.85714 49.28571 60.71429 72.14286 83.57143 95 106.4286 117.8571 129.2857 140.7143 152.1429 163.5714 175]
f_tbrake_n_bpt = [0 750 1053.571 1357.143 1660.714 1964.286 2267.857 2571.429 2875 3178.571 3482.143 3785.714 4089.286 4392.857 4696.429 5000]
NCyl = 4
Cps = 1
Vd = 0.00059936